# Grasshopper definition S3.A01_Rodrigo Aguirre_Wavy-surface.gh (Grasshopper 1.0.8)

x_position = GetNumber(Slider(0.578, range=0..1), AtLeast=1, AtMost=3, Maximum=1, Minimum=0, TreeAccess=False)
y_position = GetNumber(Slider(0.516, range=0..1), AtLeast=1, AtMost=3, Maximum=1, Minimum=0, TreeAccess=False)
frequency = GetNumber(Slider(7.57, range=0..10), AtLeast=1, AtMost=1, Maximum=10, Minimum=0, TreeAccess=False)
height = GetNumber(Slider(19.101, range=0..30), AtLeast=1, AtMost=1, Maximum=30, Minimum=0, TreeAccess=False)
pt = ConstructPoint(XCoordinate=x_position, YCoordinate=y_position, ZCoordinate=0)
planesrf = PlaneSurface(Plane=PlaneXY(0, 0, 0), XSize="100", YSize="100")
evalsrf = EvaluateSurface(Surface=reparameterize(planesrf), Point=pt)  # -> Point, Normal, UDirection, VDirection, Frame
sdivide = DivideSurface(Surface=planesrf, UCount="30", VCount="30")  # -> Points, Normals, Parameters
pull = PullPoint(Point=sdivide.Points, Geometry=evalsrf.Point, ClosestOnly=True)  # -> ClosestPoint, Distance
bnd = Bounds(Numbers=flatten(pull.Distance))
remap = RemapNumbers(Value=pull.Distance, Source=bnd, Target=frequency)  # -> Mapped, Clipped
pi = Pi(Factor=remap.Mapped)
sin = Sine(Value=pi)
bnd_2 = Bounds(Numbers=flatten(sin))
bnd_3 = Bounds(Numbers=flatten(pull.Distance))
remap_2 = RemapNumbers(Value=sin, Source=bnd_2, Target=height)  # -> Mapped, Clipped
remap_3 = RemapNumbers(Value=pull.Distance, Source=bnd_3, Target=Domain(1, 0))  # -> Mapped, Clipped
multiplication = Multiplication(A=remap_2.Mapped, B=remap_3.Mapped)
Z = UnitZ(Factor=multiplication)
move = Move(Geometry=sdivide.Points, Motion=Z)  # -> Geometry, Transform
srfgrid = SurfaceFromPoints(Points=flatten(move.Geometry), UCount=expr("x+1", "30"), Interpolate=False)
srf = Surface(srfgrid)
context_bake = ContextBake(Surface=srf)
